# Grasshopper definition UR5_Print.ghx (Grasshopper 1.0.7)

print_bed_ur5 = Geometry(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)

# ----
# Input
py = PythonScript()  # -> path
# ---------- py: Python ----------
import sys
import os

ghComp = ghenv.Component
ghDoc = ghComp.OnPingDocument()

# the full path of the gh file
path = ghDoc.FilePath
# the current directory 
#path = os.path.abspath(os.path.join(path, ".."))
path = os.path.abspath(os.path.join(path, "..", "..","02_4D_fabric","grasshopper"))

print path
# ---------- end py ----------

data = Data([Point(200, 33.3, 0), Point(133.3333333, -33.3, 0), Point(66.66666667, 33.3, 0), Point(0, -33.3, 0), Point(0, 99.96666667, 0), Point(66.66666667, 33.36666667, 0), Point(133.3333333, 99.96666667, 0), Point(200, 33.36666667, 0), Point(200, 166.6333333, 0), Point(133.3333333, 100.0333333, 0), Point(66.66666667, 166.6333333, 0), Point(0, 100.0333333, 0), Point(0, 233.3, 0), Point(66.66666667, 166.7, 0), Point(133.3333333, 233.3, 0), Point(200, 166.7, 0)])
data_2 = Data([Point(200, 20, 0), Point(194.8954309, 15.12058605, 0), Point(189.7199645, 10.31585246, 0), Point(184.7057164, 5.344266179, 0), Point(180.0382043, 0.04703556138, 0), Point(175.7302114, -5.54813779, 0)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])
data_3 = Data([Point(200, 19.7, 0), Point(194.8978387, 14.89597564, 0), Point(189.7258651, 10.16660907, 0), Point(184.7122358, 5.270858307, 0), Point(180.0404947, 0.0491054987, 0), Point(175.7247173, -5.472140462, 0)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])
data_4 = Data(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)
outedge = Data(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)
infill = Data([Point(200, 25.8, 0), Point(150, -25.8, 0), Point(100, 25.8, 0), Point(50, -25.8, 0), Point(0, 25.8, 0), Point(0, 24.2, 0)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])
cp = ControlPoints(Curve=outedge)  # -> Points, Weights, Knots
number_slider = Slider(10, range=0..10)
data_5 = Data([Point(200, 17, 0), Point(160, -17, 0), Point(120, 17, 0), Point(80, -17, 0), Point(40, 17, 0), Point(0, -17, 0), Point(0, 57, 0), Point(40, 23, 0), Point(80, 57, 0), Point(120, 23, 0)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])
data_6 = Data(cp.Points)
neg = Negative(Value=Slider(26, range=0..100))
item = ListItem(List=data_6, Index=0, Wrap=True)
Z = UnitZ(Factor=Slider(30, range=0..100))
vec = VectorXYZ(XComponent=neg, YComponent=Slider(69, range=0..100), ZComponent=0)  # -> Vector, Length
move = Move(Geometry=item, Motion=Z)  # -> Geometry, Transform
ins = InsertItems(List=data_6, Item=move.Geometry, Indices=Slider(0, range=0..100), Wrap=True)
move_2 = Move(Geometry=ins, Motion=vec.Vector)  # -> Geometry, Transform
lng = ListLength(List=move_2.Geometry)
repeat = RepeatData(Data=Slider(3, range=0..100), Length=lng)
repeat_2 = RepeatData(Data=Slider(1, range=0..1), Length=lng)
repeat_3 = RepeatData(Data=Slider(13, range=0..100), Length=lng)

tcp_z = Slider(158.6, range=0..1000)
list_split = ListSplit(L=move_2.Geometry, L_2=repeat, L_3=repeat_2, L_4=repeat_3)  # -> A, A_2, A_3, A_4
fabrication = GhPythonScript(
    points=list_split.A,
    blend_radiuses=list_split.A_2,
    extruder_toggles=list_split.A_3,
    velosities=list_split.A_4,
    myTCP_z=tcp_z,
    send=Toggle(True))  # -> out, rhino_base_way_planes, robot_planes, script; inputs points: list, blend_radiuses: list, extruder_toggles: list, velosities: list
# ---------- fabrication: Python ----------
from compas_rhino import unload_modules
unload_modules('simple_ur_script')
unload_modules('simple_comm')

import Rhino.Geometry as rg
import simple_comm as c
import simple_ur_script as ur

import math as m


def tcp(script):
    """ This funktion sets tcp 
    """
    script += ur.set_tcp_by_angles(
        float(0.0), float(0.0), float(myTCP_z), m.radians(0.0), m.radians(180.0), m.radians(90))
    return script

def set_robot_base_plane_from_pts():

    pt_0 = rg.Point3d(350, 230, 0)  # base plane origin
    # point on base plane positive x direction
    pt_1 = rg.Point3d(499, 230, 0)
    pt_2 = rg.Point3d(499, 499, 0)  # point on base plane positive xy

    robot_base = rg.Plane(pt_0, pt_1-pt_0, pt_2-pt_0)
    return robot_base

def rhino_to_robot_space(rhino_plane):
    """ this funktion translates planes from the rhino cordinate system to
    the robot cordinate system 
    """
    robot_plane = rhino_plane.Clone()
    _r_matrix = rg.Transform.PlaneToPlane(
        rg.Plane.WorldXY, set_robot_base_plane_from_pts())
    
    robot_plane.Transform(_r_matrix)
    return robot_plane
    

def point_to_rhino_plane(point):
    rhino_plane = rg.Plane(point, rg.Vector3d.XAxis, rg.Vector3d.YAxis)
    return rhino_plane

def extrude(plane, vel, blend_radi, extr, script):
    newval = 0
    vel = vel/1000
    blend_radi = blend_radi/1000
    script += ur.move_l_blend(plane, vel, blend_radi)
    
    if extr ==1:
        extr = False
        newval = True
    else:
        extr = True
        newval = False
    script += ur.set_digital_out(5, extr)
    #script += ur.set_digital_out(6,newval)
    script += ur.set_digital_out(7,newval)
    
    
    return script 


""" Robotic fabrication procedure
"""
script = ""

script = tcp(script)


"""Create rhino planes
"""

rhino_base_way_planes = []
for point in points:
    rhino_base_way_planes.append(point_to_rhino_plane(point))

"""Translate rhino planes to robot_plabe 
"""

robot_planes = []

for rhino_plane in (rhino_base_way_planes):
    robot_planes.append(rhino_to_robot_space(rhino_plane))
#    print rhino_plane.Origin
    
"""Create comands
"""

cnt = 0
for plane, velocity, blend_radi, extruder_toggle in zip(robot_planes, velosities,blend_radiuses, extruder_toggles):
    cnt += 1
    if cnt < 20000:
       script = extrude(plane, velocity, blend_radi, extruder_toggle, script)

if send:
    script = c.concatenate_script(script)
    #print script
    c.send_script(script, "192.168.10.10")
# ---------- end fabrication ----------
write_to_file = GhPythonScript(script=fabrication.script)  # -> out
# ---------- write_to_file: Python ----------
f = open("Z:/Desktop/20201207_fabrication.txt", "w")   # 'r' for reading and 'w' for writing
f.write(script)  
f.close()                                # Close file 


f = open("Z:/Desktop/20201207_fabrication.txt", "r")   # 'r' for reading and 'w' for writing
print f.read()                           # Write inside file 
f.close()                                # Close file
# ---------- end write_to_file ----------
geometry = Geometry(fabrication.robot_planes)

pline = PolyLine(Vertices=geometry, Closed=False)

data_folder_name = Panel("data")

# ---- group: Folder name
data_7 = Data(data_folder_name)

# ----
# Load Printpoints
panel = Panel("out_printpoints.json")
csloadprintpoints = CsLoadPrintpoints(recompute=Button(), json_name=panel, path=py, folder_name=data_7)  # -> out, geometry, points, frames, layer_heights, up_vectors, mesh_normals, closest_support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; inputs recompute: Boolean
# ---------- csloadprintpoints: Python ----------
"""
Loads a dictionaly of Printpoints from a json file in the 'output' folder.

"""

import compas_slicer_ghpython.visualization as gh_compas_slicer
gh_compas_slicer = reload(gh_compas_slicer)


if path and folder_name and json_name:
    points, frames, layer_heights, up_vectors, mesh_normals, closest_support, velocities, wait_times, \
    blend_radiuses, extruder_toggles = \
        gh_compas_slicer.load_printpoints(path, folder_name, json_name)
    
else:
    gh_compas_slicer.missing_input()
# ---------- end csloadprintpoints ----------

points = Point(csloadprintpoints.points)
frames = Plane(csloadprintpoints.frames)
up_vectors = Vector(csloadprintpoints.up_vectors)
mesh_normals = Vector(csloadprintpoints.mesh_normals)
cpts = Point(csloadprintpoints.closest_support)
layer_heights = Number(csloadprintpoints.layer_heights)

panel_2 = Panel(csloadprintpoints.out)
vdis = VectorDisplay(Anchor=points, Vector=expr("x*5", up_vectors))

velocities = Number(csloadprintpoints.velocities)
wait_times = Number(csloadprintpoints.wait_times)
blend_radiuses = Number(csloadprintpoints.blend_radiuses)
extruder_toggles = Number(csloadprintpoints.extruder_toggles)

pline_2 = PolyLine(Vertices=points, Closed=False)

# ==== cluster ListSplit
data = Data(Slider(600, range=0..1000))
L = ClusterInput()
L_2 = ClusterInput()
L_3 = ClusterInput()
L_4 = ClusterInput()
split = SplitList(List=L, Index=data)  # -> ListA, ListB
split_2 = SplitList(List=L_2, Index=data)  # -> ListA, ListB
split_3 = SplitList(List=L_3, Index=data)  # -> ListA, ListB
split_4 = SplitList(List=L_4, Index=data)  # -> ListA, ListB
A = ClusterOutput(split.ListA)
A_2 = ClusterOutput(split_2.ListA)
A_3 = ClusterOutput(split_3.ListA)
A_4 = ClusterOutput(split_4.ListA)
