# Grasshopper definition Geometries.ghx (Grasshopper 1.0.7)
# plug-ins: LunchBox

number_slider = Slider(200, range=0..1000)
number_slider_2 = Slider(175, range=0..1000)

number_slider_3 = Slider(600, range=0..1000)
number_slider_4 = Slider(2, range=0..10)
rectangle = Rectangle(Plane=PlaneXY(0, 0, 0), XSize=number_slider_3, YSize=number_slider_3, Radius=0)  # -> Rectangle, Length
number_slider_5 = Slider(2, range=0..10)
diamond = DiamondPanels(Surface=rectangle.Rectangle, UDivisions=Slider(1, range=0..10), VDivisions=Slider(0, range=0..10))  # -> DiamondPanels, TriPanels
neg = Negative(Value=number_slider_4)
fillet = Fillet(Curve=diamond.DiamondPanels, Radius=number_slider_5)
fillet_2 = Fillet(Curve=diamond.TriPanels, Radius=number_slider_5)
merge = Merge(Data1=fillet, Data2=fillet_2)
offset = OffsetCurve(Curve=merge, Distance=neg, Plane=PlaneXY(0, 0, 0), Corners=1)

number_slider_6 = Slider(10, range=0..10)

number_slider_7 = Slider(200, range=0..1000)
wip_geo = GhPythonScript(x=number_slider_7, y=number_slider_7)  # -> out, a
# ---------- wip_geo: Python ----------
import rhinoscriptsyntax as rs
import Rhino.Geometry as rg 
import ghpythonlib.components as gh

#define base rectangle 


origin = rg.Plane( rg.Point3d(0,0,0), rg.Vector3d.ZAxis)
rectangle = rg.Rectangle3d(origin, 200, 200)

edges = gh.Explode(rectangle, True)[0]

s_edges = gh.ListItem(edges,[1,3], False)

divided_edges = gh.DivideCurve(s_edges, 10, True)[0]

print(divided_edges)
#new_lines =rg.Line(
# ---------- end wip_geo ----------
geo = Geometry(wip_geo.a)

number_slider_8 = Slider(200, range=0..1000)
number_slider_9 = Slider(30, range=0..100)
number_slider_10 = Slider(3, range=0..10)
number_slider_11 = Slider(3, range=0..10)
print_bed_ur5 = Geometry(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)
rectangle_2 = Rectangle(Plane=PlaneXY(0, 0, 0), XSize=number_slider_2, YSize=Slider(700, range=0..1000), Radius=0)  # -> Rectangle, Length
number_slider_12 = Slider(1, range=0..1)
rectangle_3 = Rectangle(Plane=PlaneXY(0, 0, 0), XSize=number_slider_8, YSize=Slider(400, range=0..1000), Radius=0)  # -> Rectangle, Length
rectangle_4 = Rectangle(Plane=PlaneXY(0, 0, 0), XSize=Slider(500, range=0..1000), YSize=Slider(750, range=0..1000), Radius=0)  # -> Rectangle, Length
squads = SkewedQuads(Surface=rectangle_2.Rectangle, UDivisions=Slider(1, range=0..10), VDivisions=Slider(3, range=0..10), TParameter=0)  # -> FullPanels, EdgePanels
number_slider_13 = Slider(3, range=0..10)
quads = QuadPanels(Surface=rectangle.Rectangle, UDivisions=number_slider_11, VDivisions=number_slider_11)
rectangle_5 = Rectangle(Plane=PlaneXY(0, 0, 0), XSize=Slider(500, range=0..1000), YSize=Slider(800, range=0..1000), Radius=0)  # -> Rectangle, Length
explode = Explode(Curve=rectangle_3.Rectangle, Recursive=True)  # -> Segments, Vertices
explode_2 = Explode(Curve=rectangle_4.Rectangle, Recursive=True)  # -> Segments, Vertices
number_slider_14 = Slider(8, range=0..10)
number_slider_15 = Slider(7, range=0..10)
offset_2 = OffsetCurve(Curve=rectangle_5.Rectangle, Distance=1, Plane=PlaneXY(0, 0, 0), Corners=1)
X = UnitX(Factor=expr("x*2", number_slider_2))
crv = Curve(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)
merge_2 = Merge(Data1=squads.FullPanels, Data2=squads.EdgePanels)
item = ListItem(List=explode.Segments, Index=0, Wrap=True)  # -> Item, Item1, Item2, Item3
tria = TriangularPanelsA(Surface=rectangle.Rectangle, UDivisions=Slider(2, range=0..10), VDivisions=Slider(3, range=0..10))
tric = TrianglePanelsC(Surface=rectangle.Rectangle, UDivisions=number_slider_13, VDivisions=number_slider_13)
item_2 = ListItem(List=explode_2.Segments, Index=0, Wrap=True)  # -> Item, Item1, Item2, Item3
diamond_2 = DiamondPanels(Surface=rectangle_5.Rectangle, UDivisions=Slider(9, range=0..10), VDivisions=Slider(7, range=0..10))  # -> DiamondPanels, TriPanels
series = Series(Start=0, Step=0.1, Count=10)
series_2 = Series(Start=0, Step=1, Count=10)
geo_2 = Geometry(item.Item1)
geo_3 = Geometry(item.Item3)
geo_4 = Geometry(item_2.Item1)
series_3 = Series(Start=1, Step=0.2, Count=10)
geo_5 = Geometry(item_2.Item3)
mirror = Mirror(Geometry=merge_2, Plane=PlaneYZ(0, 0, 0))  # -> Geometry, Transform
offset_3 = OffsetCurve(Curve=rectangle.Rectangle, Distance=number_slider_4, Plane=PlaneXY(0, 0, 0), Corners=1)
graph = GraphMapper(series, x0=0, x1=1, y0=0, y1=1, Ox=0, Oy=0, Px=0.776023984, Py=0.404256165, container_name="Parabola")
flip = FlipCurve(Curve=geo_3)  # -> Curve, Flag
panel = Panel("""2.2
4.4""")
divide = DivideCurve(Curve=item_2.Item1, Count=number_slider_15, Kinks=False)  # -> Points, Tangents, Parameters
divide_2 = DivideCurve(Curve=item_2.Item3, Count=number_slider_15, Kinks=False)  # -> reverse(Points), Tangents, Parameters
scale_nu = ScaleNU(Geometry=crv, Plane=PlaneXY(0, 0, 0), ScaleX=1, ScaleY=series_3, ScaleZ=1)  # -> Geometry, Transform
pl = ConstructPlane(Origin=Point(0, 0, 0), XAxis=Vector(1, 0, 0), YAxis=Vector(0, 1, 0))
merge_3 = Merge(Data1=merge_2, Data2=mirror.Geometry)
eval = EvaluateCurve(Curve=reparameterize(flip.Curve), Parameter=graph)  # -> Point, Tangent, Angle
eval_2 = EvaluateCurve(Curve=reparameterize(geo_2), Parameter=graph)  # -> Point, Tangent, Angle
ln = Line(StartPoint=divide.Points, EndPoint=divide_2.Points)
number_slider_16 = Slider(53.6, range=0..100)
offset_4 = OffsetCurve(Curve=tric, Distance=neg, Plane=PlaneXY(0, 0, 0), Corners=1)
merge_4 = Merge(Data1=offset, Data2=offset_3)  # -> flatten(Result)
offset_5 = OffsetCurve(Curve=rectangle.Rectangle, Distance=panel, Plane=PlaneXY(0, 0, 0), Corners=1)
dispatch = Dispatch(List=ln, DispatchPattern=[True, False])  # -> ListA, ListB
orient = Orient(Geometry=scale_nu.Geometry, Source=pl, Target=eval.Point)  # -> Geometry, Transform
divide_3 = DivideCurve(Curve=dispatch.ListB, Count=number_slider_14, Kinks=False)  # -> Points, Tangents, Parameters
mirror_2 = Mirror(Geometry=orient.Geometry, Plane=PlaneYZ(0, 0, 0))  # -> Geometry, Transform
divide_4 = DivideCurve(Curve=dispatch.ListA, Count=number_slider_14, Kinks=False)  # -> Points, Tangents, Parameters
fillet_3 = Fillet(Curve=offset_4, Radius=Slider(3, range=0..10))
X_2 = UnitX(Factor=number_slider_8)
panel_2 = Panel("""3
3
3
3
-3
-3
-3
-3""")
dispatch_2 = Dispatch(List=orient.Geometry, DispatchPattern=[True, False])  # -> ListA, ListB
Y = UnitY(Factor=number_slider_16)
dispatch_3 = Dispatch(List=divide_3.Points, DispatchPattern=[True, False])  # -> ListA, ListB
dispatch_4 = Dispatch(List=divide_4.Points, DispatchPattern=[True, False])  # -> ListA, ListB
Y_2 = UnitY(Factor=number_slider_16)
move = Move(Geometry=mirror_2.Geometry, Motion=X_2)  # -> Geometry, Transform
Y_3 = UnitY(Factor=number_slider_16)
flip_2 = FlipCurve(Curve=dispatch_2.ListA)  # -> Curve, Flag
offset_6 = OffsetCurve(Curve=merge_3, Distance=expr("-x", panel_2), Plane=PlaneXY(0, 0, 0), Corners=1)
arrlinear = LinearArray(Geometry=offset_6, Direction=X, Count=Slider(2, range=0..10))  # -> flatten(Geometry), Transform
area = Area(Geometry=arrlinear.Geometry)  # -> Area, Centroid
pdecon = Deconstruct(Point=area.Centroid)  # -> XComponent, YComponent, ZComponent
sort = SortList(Keys=pdecon.XComponent, ValuesA=arrlinear.Geometry)  # -> Keys, ValuesA
Y_4 = UnitY(Factor=number_slider_16)
rev = Reverse(Vector=Y_3)
dispatch_5 = Dispatch(List=move.Geometry, DispatchPattern=[True, False])  # -> ListA, ListB
geo_6 = Geometry(sort.ValuesA)
move_2 = Move(Geometry=dispatch_4.ListA, Motion=Y_2)  # -> Geometry, Transform
rev_2 = Reverse(Vector=Y)
move_3 = Move(Geometry=dispatch_4.ListB, Motion=rev_2)  # -> Geometry, Transform
bbox = BoundingBox(Content=geo_6, Plane=PlaneXY(0, 0, 0), UnionBox=True)  # -> Box, Box_2
move_4 = Move(Geometry=dispatch_3.ListA, Motion=rev)  # -> Geometry, Transform
weave = Weave(Pattern=[0, 1], Stream0=flip_2.Curve, Stream1=dispatch_2.ListB, NullGaps=False)
move_5 = Move(Geometry=dispatch_3.ListB, Motion=Y_4)  # -> Geometry, Transform
flip_3 = FlipCurve(Curve=dispatch_5.ListA)  # -> Curve, Flag
debrep = DeconstructBrep(Brep=bbox.Box)  # -> Faces, Edges, Vertices
weave_2 = Weave(Pattern=[0, 1], Stream0=move_2.Geometry, Stream1=move_3.Geometry, NullGaps=False)
weave_3 = Weave(Pattern=[0, 1], Stream0=move_4.Geometry, Stream1=move_5.Geometry, NullGaps=False)
weave_4 = Weave(Pattern=[0, 1], Stream0=flip_3.Curve, Stream1=dispatch_5.ListB, NullGaps=False)
item_3 = ListItem(List=debrep.Faces, Index=0, Wrap=True)
pline = PolyLine(Vertices=weave_2, Closed=False)
debrep_2 = DeconstructBrep(Brep=item_3)  # -> Faces, Edges, Vertices
pline_2 = PolyLine(Vertices=weave_3, Closed=False)
divide_5 = DivideCurve(Curve=pline, Count=10, Kinks=False)  # -> Points, Tangents, Parameters
merge_5 = Merge(Data1=reverse(weave_4), Data2=weave)
rectangle_6 = Rectangle(Plane=PlaneXY(0, 0, 0), XSize=Slider(500, range=0..1000), YSize=Slider(800, range=0..1000), Radius=0)  # -> Rectangle, Length
join = JoinCurves(Curves=debrep_2.Edges, Preserve=False)
divide_6 = DivideCurve(Curve=pline_2, Count=10, Kinks=False)  # -> reverse(Points), Tangents, Parameters
cp = ControlPoints(Curve=pline)  # -> Points, Weights, Knots
intcrv = Interpolate(Vertices=divide_5.Points, Degree=3, Periodic=False, KnotStyle=1)  # -> Curve, Length, Domain
cp_2 = ControlPoints(Curve=pline_2)  # -> reverse(Points), Weights, Knots
intcrv_2 = Interpolate(Vertices=divide_6.Points, Degree=3, Periodic=False, KnotStyle=1)  # -> Curve, Length, Domain
offset_7 = OffsetCurve(Curve=join, Distance=Slider(6, range=0..10), Plane=PlaneXY(0, 0, 0), Corners=1)
layer_height = Slider(2, range=0..10)
layer_number = Slider(1, range=0..10)
divide_7 = DivideCurve(Curve=merge_5, Count=Slider(20, range=0..100), Kinks=False)  # -> Points, Tangents, Parameters
merge_6 = Merge(Data1=flatten(offset_5), Data2=flatten(fillet_3))  # -> flatten(Result)
diamond_3 = DiamondPanels(Surface=rectangle_6.Rectangle, UDivisions=Slider(7, range=0..10), VDivisions=Slider(5, range=0..10))  # -> DiamondPanels, TriPanels
Z = UnitZ(Factor=Slider(20, range=0..100))
item_4 = ListItem(List=divide_7.Points, Index=0, Wrap=True)  # -> Item1, Item
number_slider_17 = Slider(41, range=0..100)
merge_7 = Merge(Data1=cp.Points, Data2=cp_2.Points)  # -> flatten(Result)
data = Data()

horizontal_count = Slider(1, range=0..10)
list = ValueList({"One": 1, "Two": 2, "Three": 2² - 1, "Four": Sqrt(16)}, selected="One")
data_2 = Data(geo_6)
crv_2 = Curve(data_2)

geo_7 = Geometry(merge_6)
geo_8 = Geometry()
move_6 = Move(Geometry=item_4.Item1, Motion=Z)  # -> Geometry, Transform
merge_8 = Merge(Data1=diamond_3.DiamondPanels, Data2=diamond_3.TriPanels)

horizontal_count_2 = Slider(1, range=0..10)
list_2 = ValueList({"One": 1, "Two": 2, "Three": 2² - 1, "Four": Sqrt(16)}, selected="One")
data_3 = Data(merge_8)
crv_3 = Curve(data_3)

move_7 = Move(Geometry=item_4.Item, Motion=Z)  # -> Geometry, Transform
pline_3 = PolyLine(Vertices=merge_7, Closed=False)
data_4 = Data(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)
neg_2 = Negative(Value=Slider(2.1, range=0..10))

layer_height_2 = Slider(2, range=0..10)
line_space = Slider(1.5, range=0..10)

Z_2 = UnitZ(Factor=Slider(1, range=0..1))
panel_3 = Panel("""-1
0""")
merge_9 = Merge(Data1=move_6.Geometry, Data2=move_7.Geometry)
move_8 = Move(Geometry=merge_7, Motion=Z_2)  # -> reverse(Geometry), Transform
bbox_2 = BoundingBox(Content=pline_3, Plane=PlaneXY(0, 0, 0))  # -> Box, Box_2
offset_8 = OffsetCurve(Curve=merge_8, Distance=neg_2, Plane=PlaneXY(0, 0, 0), Corners=1)  # -> flatten(Curve)
cluster = Cluster(B_2=offset_8, A=layer_height, B=layer_number)
offset_9 = OffsetCurve(Curve=rectangle_6.Rectangle, Distance=Slider(1.5, range=0..10), Plane=PlaneXY(0, 0, 0), Corners=1)

# ----
# Export obj. to data
panel_4 = Panel("20210722_diamond_large_in.obj")
mjoin = MeshJoin(Meshes=cluster)
export_obj = GhPythonScript(export=Button(), mesh=mjoin, ObjName=panel_4)  # -> out, a; inputs mesh: Mesh
# ---------- export_obj: Python ----------
import os
import sys
import compas_rhino
from compas_rhino.geometry import RhinoMesh
import Rhino.Geometry as rg 


filepath = ghenv.Component.Attributes.Owner.OnPingDocument().FilePath
path = os.path.abspath(os.path.join(filepath, "..","data","3D_for_4D.obj"))
path_storage = os.path.abspath(os.path.join(filepath, "..", "..","obj",ObjName))

print (path_storage)
HERE = os.path.join(os.path.abspath(path)) 
HERE_storage = os.path.join(os.path.abspath(path_storage))

#######


if export:
    print(HERE)
    print(HERE_storage)
    c_mesh = RhinoMesh.from_geometry(mesh).to_compas()
    c_mesh.to_obj(HERE, None, True)
    c_mesh.to_obj(HERE_storage, None, True)
# ---------- end export_obj ----------

ins = InsertItems(List=divide_7.Points, Item=merge_9, Indices=panel_3, Wrap=True)
data_5 = Data([Point(200, 25.8, 0), Point(150, -25.8, 0), Point(100, 25.8, 0), Point(50, -25.8, 0), Point(0, 25.8, 0), Point(0, 24.2, 0), Point(50, 75.8, 0), Point(100, 24.2, 0), Point(150, 75.8, 0), Point(200, 24.2, 0), Point(200, 125.8, 0), Point(150, 74.2, 0), Point(100, 125.8, 0), Point(50, 74.2, 0), Point(0, 125.8, 0), Point(0, 124.2, 0), Point(50, 175.8, 0), Point(100, 124.2, 0), Point(150, 175.8, 0), Point(200, 124.2, 0), Point(200, 225.8, 0), Point(150, 174.2, 0), Point(100, 225.8, 0), Point(50, 174.2, 0), Point(0, 225.8, 0)])
merge_10 = Merge(Data1=merge_7, Data2=move_8.Geometry)
debrep_3 = DeconstructBrep(Brep=bbox_2.Box)  # -> Faces, Edges, Vertices
merge_11 = Merge(Data1=rectangle_6.Rectangle, Data2=offset_9)  # -> flatten(Result)
pline_4 = PolyLine(Vertices=merge_10, Closed=False)
geo_9 = Geometry(Tree({0;0;0;0}: [Point(200.3343402, 217.6392113, 30), Point(200.3343402, 217.6392113, 0), Point(194.4100794, 231.8920592, 0), Point(188.2786415, 246.05699, 0), Point(181.9218697, 260.1222062, 0), Point(175.3187238, 274.0734099, 0)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], {0;0;1;0}: [Point(200.3343402, 171.9816663, 30), Point(200.3343402, 171.9816663, 0), Point(194.265392, 185.5331842, 0), Point(187.9841356, 198.9875808, 0), Point(181.4722979, 212.3318654, 0), Point(174.708784, 225.5503193, 0)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], {0;0;2;0}: [Point(200.3343402, 131.6943942, 30), Point(200.3343402, 131.6943942, 0), Point(194.0998566, 144.5376321, 0), Point(187.6478201, 157.272934, 0), Point(180.9599939, 169.8859665, 0), Point(174.0154382, 182.3594321, 0)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], {0;0;3;0}: [Point(200.3343402, 96.77739494, 30), Point(200.3343402, 96.77739494, 0), Point(193.9097477, 108.9017108, 0), Point(187.2624915, 120.905356, 0), Point(180.3746132, 132.7725158, 0), Point(173.2256484, 144.4841832, 0)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], {0;0;4;0}: [Point(200.3343402, 67.23066851, 30), Point(200.3343402, 67.23066851, 0), Point(193.690762, 78.62019074, 0), Point(186.8199803, 89.87406748, 0), Point(179.7046839, 100.9749097, 0), Point(172.3253554, 111.9019465, 0)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], {0;0;5;0}: [Point(200.3343402, 43.05421492, 30), Point(200.3343402, 43.05421492, 0), Point(193.4381212, 53.68567374, 0), Point(186.3114682, 64.16401122, 0), Point(178.9382578, 74.47028122, 0), Point(171.3005911, 84.58204933, 0)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]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))
join_2 = JoinCurves(Curves=debrep_3.Edges, Preserve=False)
geo_10 = Geometry([Point(500, 53.6, 0), Point(437.5, -53.6, 0), Point(375, 53.6, 0), Point(312.5, -53.6, 0), Point(250, 53.6, 0), Point(187.5, -53.6, 0)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])
geo_11 = Geometry(<curve referenced from the Rhino model>)
offset_10 = OffsetCurve(Curve=join_2, Distance=Slider(2, range=0..10), Plane=PlaneXY(0, 0, 0), Corners=1)
pline_5 = PolyLine(Vertices=flatten(ins), Closed=False)
merge_12 = Merge(Data1=geo_11, Data2=offset_10)  # -> flatten(Result)

parameters_for_mesh = ParametersForMesh(
    data=line_space,
    data_2=layer_height_2,
    crv=crv_3,
    C_2=horizontal_count_2,
    A_2=list_2,
    crv_3=crv_2,
    C=horizontal_count,
    A=list)  # -> M_2, M
mesh = Mesh(parameters_for_mesh.M_2)
mesh_2 = Mesh(parameters_for_mesh.M)
merge_13 = Merge(Data1=mesh, Data2=mesh_2)  # -> flatten(Result)
geo_12 = Geometry(merge_13)
mjoin_2 = MeshJoin(Meshes=geo_12)
export_obj_2 = GhPythonScript(export=Button(), mesh=mjoin_2, ObjName="20210712_arrow_2.obj")  # -> out, a; inputs mesh: Mesh
# ---------- export_obj_2: Python ----------
import os
import sys
import compas_rhino
from compas_rhino.geometry import RhinoMesh
import Rhino.Geometry as rg 


filepath = ghenv.Component.Attributes.Owner.OnPingDocument().FilePath

#path is the main stream save .obj in the "data" folder for slicing

path = os.path.abspath(os.path.join(filepath, "..","data","3D_for_4D.obj"))

#path_storage is the main second saver to .obj in the "obj" folder for documentation
#change ObjName in the panel to not overwrite your archives .obj

path_storage = os.path.abspath(os.path.join(filepath, "..", "..","obj",ObjName))


print (path_storage)
HERE = os.path.join(os.path.abspath(path)) 
HERE_storage = os.path.join(os.path.abspath(path_storage))

#######


if export:
    print(HERE)
    c_mesh = RhinoMesh.from_geometry(mesh).to_compas()
    c_mesh.to_obj(HERE, None, True)
    c_mesh.to_obj(HERE_storage, None, True)
# ---------- end export_obj_2 ----------

cp_3 = ControlPoints(Curve=offset_10)  # -> Points, Weights, Knots
crv_4 = Curve([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])
infill = Data([Point(200, 25.8, 0), Point(150, -25.8, 0), Point(100, 25.8, 0), Point(50, -25.8, 0), Point(0, 25.8, 0), Point(0, 24.2, 0)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])
outedge = Data(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)
crv_5 = Curve(cp_3.Points)

# ==== cluster Cluster
A = ClusterInput()
B = ClusterInput()
multiplication = Multiplication(A=A, B=B)
B_2 = ClusterInput()
Z = UnitZ(Factor=expr("x-0.05", multiplication))
extr = Extrude(Base=B_2, Direction=Z)
rebsrf = RebuildSurface(Surface=extr, CountU=Slider(3, range=0..10), CountV=Slider(300, range=0..1000))
mjoin = MeshJoin(Meshes=rebsrf)
tri = Triangulate(Mesh=mjoin)  # -> Mesh, Count
M = ClusterOutput(tri.Mesh)

# ==== cluster ParametersForMesh
C = ClusterInput()
C_2 = ClusterInput()
data = ClusterInput()
data_2 = ClusterInput()
data_3 = Data(data)
data_4 = Data(data_2)
A = ClusterInput()
A_2 = ClusterInput()
crv = ClusterInput()

# ---- group: Edge Curves
multiplication = Multiplication(A=data_3, B=Slider(2, range=0..10))
multiplication_2 = Multiplication(A=A_2, B=data_4)
series = Series(Start=data_3, Step=multiplication, Count=C_2)
subtraction = Subtraction(A=multiplication_2, B=Slider(0.05, range=0..0.1))
crv_2 = Curve(crv)
Z = UnitZ(Factor=subtraction)
extr = Extrude(Base=crv_2, Direction=Z)
mesh = MeshBrep(
    Brep=extr,
    Settings={GridMaxCount=0, GridMinCount=16, JaggedSeams=False, MaxEdgeLength=0, MinEdgeLength=0.0001, MinTolerance=0, Refine=True, RefineAngle=0, RelativeTolerance=0.65, SimplePlanes=True, Tolerance=0})
tri = Triangulate(Mesh=mesh)  # -> Mesh, Count

# ----
crv_3 = ClusterInput()

# ---- group: Filler_Curves
multiplication_3 = Multiplication(A=data_3, B=Slider(2, range=0..10))
multiplication_4 = Multiplication(A=A, B=data_4)
series_2 = Series(Start=data_3, Step=multiplication_3, Count=C)
subtraction_2 = Subtraction(A=multiplication_4, B=Slider(0.05, range=0..0.1))
neg = Negative(Value=series_2)
crv_4 = Curve(crv_3)
Z_2 = UnitZ(Factor=subtraction_2)
extr_2 = Extrude(Base=crv_4, Direction=Z_2)
mesh_2 = MeshBrep(
    Brep=extr_2,
    Settings={GridMaxCount=0, GridMinCount=16, JaggedSeams=False, MaxEdgeLength=0, MinEdgeLength=0.0001, MinTolerance=0, Refine=True, RefineAngle=0, RelativeTolerance=0.65, SimplePlanes=True, Tolerance=0})
tri_2 = Triangulate(Mesh=mesh_2)  # -> Mesh, Count

# ----
M = ClusterOutput(tri_2.Mesh)
M_2 = ClusterOutput(tri.Mesh)
